# Grasshopper definition cw_example_facade.gh (Grasshopper 1.0.7)
# plug-ins: CadworkGrasshopper

# ----
# supported by
# Ursula Frick
# Head of Advanced Geometry Group
# Blumer-Lehmann AG
image = ImageSampler(
    FilePath="C:\Users\admin\Downloads\cadwork-vector-logo.png",
    Filter="Colour",
    Interpolate=True,
    Umax=875,
    Umin=1,
    Vmax=196,
    Vmin=1,
    Wrap=1)

formdefiningguidecrvs = Curve(graft([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]))
number_of_elements = Slider(80, range=0..1000)
thickness = Slider(39, range=0..100)
logo_as_closedcrvs = Curve(flatten([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]))

# ---- group: Extract the 1st straight line
item = ListItem(List=flatten(formdefiningguidecrvs), Index=0, Wrap=True)

# ----
pframes = PerpFrames(Curve=item, Count=number_of_elements, Align=True)  # -> Frames, Parameters
X = UnitX(Factor=thickness)
boundary = BoundarySurfaces(Edges=logo_as_closedcrvs)
pcx = CurvePlane(Curve=formdefiningguidecrvs, Plane=pframes.Frames)  # -> simplify(Points), ParamsC, ParamsP
path_mapper = PathMapper(pcx.Points, source="{A;B}", target="{A}")
flip = FlipMatrix(Data=path_mapper)
pline = PolyLine(Vertices=flip, Closed=True)
boundary_2 = BoundarySurfaces(Edges=pline)
extr = Extrude(Base=boundary, Direction=X)
extr_2 = Extrude(Base=boundary_2, Direction=X)
sdiff = SolidDifference(BrepsA=extr_2, BrepsB=flatten(extr))  # -> flatten(Result)
lng = ListLength(List=sdiff)

# ---- group: Set Parameters
panel = Panel("Fassadenbalken")
panel_2 = Panel("Fassade")
panel_3 = Panel("Fassade_Süd")
panel_4 = Panel("cw_FireRating")
panel_5 = Panel("R30")
panel_6 = Panel("Eiche")
number_slider = Slider(42, range=0..42)
starting_nr_prod_list = Panel("100")
panel_7 = Panel("Grasshopper_Building")
panel_8 = Panel("Grasshopper_Storey")
panel_9 = Panel("IfcMember")

# ----
series = Series(Start=starting_nr_prod_list, Step=1, Count=lng)

cw_std_attr = StdAttr(
    Material=panel_6,
    Color=number_slider,
    Nr_Prod_List=series,
    BIM_Building=panel_7,
    BIM_Storey=panel_8,
    Ifc_Element_Type=panel_9)
cw_attr = CwAttr(Name=panel, Group=panel_2, Subgroup=panel_3, User199Keys=panel_4, User199Values=panel_5)

cw_panel = Panel(Geom=flatten(sdiff), CwAttr=flatten(cw_attr), StdAttr=flatten(cw_std_attr))
