# Grasshopper definition cw_simple_beam.gh (Grasshopper 1.0.7)
# plug-ins: CadworkGrasshopper

image = ImageSampler(Filter="Colour", Interpolate=True, Umax=875, Umin=1, Vmax=196, Vmin=1, Wrap=1)

height = Slider(480, range=0..1000)
length = Slider(2500, range=0..10000)
# Dimensions
width = Slider(240, range=0..1000)

xy_plane = XYPlane(Origin=Point(0, 0, 0))
# Plane, footprint & box
rectangle = Rectangle(Plane=xy_plane, XSize=width, YSize=height, Radius=0)  # -> Rectangle, Length

expression = Expression(Expression="{0,1,0}")
expression_2 = Expression(Expression="{0,0,1}")

box_rectangle = BoxRectangle(Rectangle=rectangle.Rectangle, Height=length)
# Axis
axis = Axis(VectorXLocal=expression_2, VectorZLocal=expression)
# Attributes
stdattr = StdAttr(
    Material="GL 24h I",
    Color=Slider(7, range=0..10),
    BIMBuilding="TestBuilding",
    BIMStorey="TestStorey",
    IfcElementType="IfcColumn")
panel = Panel(axis)
cluster = Cluster()  # -> image_2, panel_2
beam = Beam(Geom=box_rectangle, Axis=axis, StdAttr=stdattr, EndtypeStart="Z_40", EndtypeEnd="Z_40", BakeCW=False)

# ==== cluster Cluster
image = ImageSampler(Filter="Colour", Interpolate=True, Umax=875, Umin=1, Vmax=196, Vmin=1, Wrap=1)

height = Slider(480, range=0..1000)
length = Slider(2500, range=0..10000)
# Dimensions
width = Slider(240, range=0..1000)

xy_plane = XYPlane(Origin=Point(0, 0, 0))
image_2 = ClusterOutput(image)
# Plane, footprint & box
rectangle = Rectangle(Plane=xy_plane, XSize=width, YSize=height, Radius=0)  # -> Rectangle, Length

expression = Expression(Expression="{0,1,0}")
expression_2 = Expression(Expression="{0,0,1}")

box_rectangle = BoxRectangle(Rectangle=rectangle.Rectangle, Height=length)
# Axis
axis = Axis(VectorXLocal=expression_2, VectorZLocal=expression)
# Attributes
stdattr = StdAttr(
    Material="GL 24h I",
    Color=Slider(7, range=0..10),
    BIMBuilding="TestBuilding",
    BIMStorey="TestStorey",
    IfcElementType="IfcColumn")
panel = Panel(axis)
panel_2 = ClusterOutput(panel)
beam = Beam(Geom=box_rectangle, Axis=axis, StdAttr=stdattr, EndtypeStart="Z_40", EndtypeEnd="Z_40", BakeCW=False)
