# Grasshopper definition cw_sine_plates.gh (Grasshopper 1.0.7)
# plug-ins: CadworkGrasshopper

länge_mm = Slider(1998, range=0..2500)
image = ImageSampler(
    FilePath="C:\Users\admin\Downloads\cadwork-vector-logo.png",
    Filter="Colour",
    Interpolate=True,
    Umax=875,
    Umin=1,
    Vmax=196,
    Vmin=1,
    Wrap=1)
sinus_kurven_anzahl = Slider(3, range=0..10)
panel = Panel("""300
-300""")

pt = ConstructPoint(XCoordinate=0, YCoordinate=0, ZCoordinate=0)
X = UnitX(Factor=1)
line = LineSDL(Start=pt, Direction=X, Length=länge_mm)

Z = UnitZ(Factor=panel)
divide = DivideCurve(Curve=line, Count=10, Kinks=False)  # -> Points, Tangents, Parameters

pi = Pi(Factor=sinus_kurven_anzahl)
multiplication = Multiplication(A=divide.Parameters, B=pi)
sin = Sine(Value=multiplication)
radius = Slider(112, range=0..200)
multiplication_2 = Multiplication(A=sin, B=radius)

pdecon = Deconstruct(Point=divide.Points)  # -> XComponent, YComponent, ZComponent
lng = ListLength(List=Z)
move = Move(Geometry=line, Motion=Z)  # -> graft(Geometry), Transform
pt_2 = ConstructPoint(XCoordinate=pdecon.XComponent, YCoordinate=pdecon.YComponent, ZCoordinate=multiplication_2)
flip = FlipCurve(Curve=move.Geometry)  # -> Curve, Flag
intcrv = Interpolate(Vertices=pt_2, Degree=3, Periodic=False, KnotStyle=1)  # -> Curve, Length, Domain
repeat = RepeatData(Data=intcrv.Curve, Length=lng)  # -> graft(Data)
merge = Merge(Data1=simplify(flip.Curve), Data2=simplify(repeat))
connect = ConnectCurves(Curves=merge, Continuity=0, Close=True, Bulge=1)  # -> flatten(Curve)
expression = Expression(Expression="{0,0,0}")

lichtmass_mm = Slider(20, range=0..100)
plattendicke_mm = Slider(27, range=0..100)

X_2 = UnitX(Factor=1)
item = ListItem(List=connect, Index=0, Wrap=True)  # -> Item, Item1
line_2 = LineSDL(Start=expression, Direction=X_2, Length=1)
addition = Addition(A=plattendicke_mm, B=lichtmass_mm)
rotax = RotateAxis(Geometry=item.Item, Angle=degrees(Slider(180, range=0..1000)), Axis=line_2)  # -> Geometry, Transform
Y = UnitY(Factor=addition)
crv = Curve(item.Item1)
expression_2 = Expression(x=addition, Expression="x*2")
Y_2 = UnitY(Factor=plattendicke_mm)
move_2 = Move(Geometry=rotax.Geometry, Motion=Y)  # -> Geometry, Transform
series = Series(Start=0, Step=expression_2, Count=Slider(10, range=0..100))
extr = Extrude(Base=[crv, move_2.Geometry], Direction=Y_2)
Y_3 = UnitY(Factor=series)  # -> graft(UnitVector)
cap = CapHoles(Brep=extr)
move_3 = Move(Geometry=cap, Motion=Y_3)  # -> Geometry, Transform
cw_std_attr = StdAttr(Material="OSB", Color=Slider(10, range=0..10))
cw_attr = CwAttr(Name="plate", Group="facade")
cw_panel = Panel(Geom=flatten(move_3.Geometry), CwAttr=cw_attr, StdAttr=cw_std_attr)
