# Grasshopper definition cw_sweep_beam.gh (Grasshopper 1.0.7)
# plug-ins: CadworkGrasshopper

image = ImageSampler(
    FilePath="C:\Users\admin\Downloads\cadwork-vector-logo.png",
    Filter="Colour",
    Interpolate=True,
    Umax=875,
    Umin=1,
    Vmax=196,
    Vmin=1,
    Wrap=1)

geometry = Geometry([Point(-1934.755083, 818.3353098, 0), Point(421.990113, -2640.758445, -195.1792789), Point(4451.264157, -1170.960366, -356.0859939), Point(4425.922811, 1781.306465, 0), Point(1635.124457, 4368.79635, 547.4903925), Point(-411.9596108, 10052.17214, 1265.382933)])

interpolate_t = InterpolateT(Vertices=geometry, TangentStart=Vector(0, 0, 0), TangentEnd=Vector(0, 0, 0), KnotStyle=1)  # -> Curve, Length, Domain
perp_frame = PerpFrame(Curve=reparameterize(interpolate_t.Curve), Parameter=Slider(0, range=0..1))
number_slider = Slider(120, range=0..1000)
number_slider_2 = Slider(240, range=0..1000)
rebuild_curve = RebuildCurve(Curve=interpolate_t.Curve, Degree=Slider(3, range=0..10), Count=10, Tangents=False)

panel = Panel("""Cadwork Holz AG
True""")
panel_2 = Panel("""cw_Lieferant
cw_LoadBearing""")

construct_domain = ConstructDomain(DomainStart=expr("x *0.5", number_slider), DomainEnd=expr("-x *0.5", number_slider))
construct_domain_2 = ConstructDomain(DomainStart=expr("x *0.5", number_slider_2), DomainEnd=expr("-x *0.5", number_slider_2))
cwattr = CwAttr(Name="Beam", User199Keys=panel_2, User199Values=panel)
rectangle = Rectangle(Plane=perp_frame, XSize=construct_domain, YSize=construct_domain_2, Radius=0)  # -> Rectangle, Length
sweep1 = Sweep1(Rail=rebuild_curve, Sections=rectangle.Rectangle, Miter=1)

integer = Integer(5)

cap_holes = CapHoles(Brep=sweep1)
stdattr = StdAttr(Material="GL 24h I", Color=integer, BIMBuilding="TestBuilding", BIMStorey="TestStorey", IfcElementType="IfcMember")
beam = Beam(Geom=flatten(cap_holes), CwAttr=cwattr, StdAttr=stdattr)
