# Grasshopper definition cw_undulating_surface.gh (Grasshopper 1.0.7)
# plug-ins: CadworkGrasshopper

image = ImageSampler(
    FilePath="C:\Users\admin\Downloads\cadwork-vector-logo.png",
    Filter="Colour",
    Interpolate=True,
    Umax=875,
    Umin=1,
    Vmax=196,
    Vmin=1,
    Wrap=1)
number_slider = Slider(400, range=0..1000)
number_slider_2 = Slider(11, range=0..20)
construct_domain = ConstructDomain(DomainStart=expr("-x", number_slider), DomainEnd=number_slider)
sqgrid = Square(Plane=PlaneXY(0, 0, 0), Size=Slider(500, range=0..1000), ExtentX=number_slider_2, ExtentY=number_slider_2)  # -> Cells, Points
lng = ListLength(List=flatten(sqgrid.Points))
random = Random(Range=construct_domain, Number=expr("x-1", lng), Seed=2)
Z = UnitZ(Factor=random)
pt = Point(sqgrid.Points)
move = Move(Geometry=graft(pt), Motion=graft(Z))  # -> Geometry, Transform
srfgrid = SurfaceFromPoints(Points=flatten(move.Geometry), UCount=expr("x+1", number_slider_2), Interpolate=False)
surface = Surface(Geom=flatten(srfgrid))
